% Simulink data dictionary CarDict.sldd

numSurf = 2
torqueRadius = 300
pistonArea = 0.65
clutchPressureTresh = Simulink.Parameter(2000, DataType="double", Min=0, Max=10000, Unit="Pa")
pressureGain = Simulink.Parameter(10000, Min=100, Max=10000, Unit="Pa")
clutchVeloTolRads = 0.001